test file "FCW_Validation"

suite "FCW_Functional_Tests"

  case "FCW_Automated_Test" [baseline]
    model FCW, harness FCW_Harness (for FCW/Subsystem)
    parameter set "PS_FCW_001" (off): tc_distance = 20, tc_vrel = -10, tc_targetPresent = 0, tc_targetInLane = 0, tc_expectedSafe = 1, tc_expectedYellow = 0, tc_expectedRed = 0
    parameter set "PS_FCW_002" (off): tc_distance = 20, tc_vrel = -10, tc_targetPresent = 1, tc_targetInLane = 0, tc_expectedSafe = 1, tc_expectedYellow = 0, tc_expectedRed = 0
    parameter set "PS_FCW_003" (off): tc_distance = 20, tc_vrel = 0, tc_targetPresent = 1, tc_targetInLane = 1, tc_expectedSafe = 1, tc_expectedYellow = 0, tc_expectedRed = 0
    parameter set "PS_FCW_004" (off): tc_distance = 20, tc_vrel = 5, tc_targetPresent = 1, tc_targetInLane = 1, tc_expectedSafe = 1, tc_expectedYellow = 0, tc_expectedRed = 0
    parameter set "PS_FCW_005" (off): tc_distance = 80, tc_vrel = -2, tc_targetPresent = 1, tc_targetInLane = 1, tc_expectedSafe = 1, tc_expectedYellow = 0, tc_expectedRed = 0
    parameter set "PS_FCW_006" (off): tc_distance = 20, tc_vrel = -5, tc_targetPresent = 1, tc_targetInLane = 1, tc_expectedSafe = 0, tc_expectedYellow = 1, tc_expectedRed = 0
    parameter set "PS_FCW_007" (off): tc_distance = 20.5, tc_vrel = -5, tc_targetPresent = 1, tc_targetInLane = 1, tc_expectedSafe = 1, tc_expectedYellow = 0, tc_expectedRed = 0
    parameter set "PS_FCW_008" (off): tc_distance = 9.18877551020408, tc_vrel = -5, tc_targetPresent = 1, tc_targetInLane = 1, tc_expectedSafe = 0, tc_expectedYellow = 0, tc_expectedRed = 1
    parameter set "PS_FCW_009" (off): tc_distance = 9, tc_vrel = -5, tc_targetPresent = 1, tc_targetInLane = 1, tc_expectedSafe = 0, tc_expectedYellow = 0, tc_expectedRed = 1
    parameter set "PS_FCW_010" (off): tc_distance = 10, tc_vrel = -5, tc_targetPresent = 1, tc_targetInLane = 1, tc_expectedSafe = 0, tc_expectedYellow = 1, tc_expectedRed = 0
    parameter set "PS_FCW_011" (off): tc_distance = 24.7551020408163, tc_vrel = -10, tc_targetPresent = 1, tc_targetInLane = 1, tc_expectedSafe = 0, tc_expectedYellow = 0, tc_expectedRed = 1
    parameter set "PS_FCW_012" (off): tc_distance = 25, tc_vrel = -10, tc_targetPresent = 1, tc_targetInLane = 1, tc_expectedSafe = 0, tc_expectedYellow = 1, tc_expectedRed = 0
    parameter set "PS_FCW_013" (off): tc_distance = 40, tc_vrel = -10, tc_targetPresent = 1, tc_targetInLane = 1, tc_expectedSafe = 0, tc_expectedYellow = 1, tc_expectedRed = 0
    parameter set "PS_FCW_014" (off): tc_distance = 40.1, tc_vrel = -10, tc_targetPresent = 1, tc_targetInLane = 1, tc_expectedSafe = 1, tc_expectedYellow = 0, tc_expectedRed = 0
    parameter set "PS_FCW_015" (off): tc_distance = 46.6989795918367, tc_vrel = -15, tc_targetPresent = 1, tc_targetInLane = 1, tc_expectedSafe = 0, tc_expectedYellow = 0, tc_expectedRed = 1
    parameter set "PS_FCW_016" (off): tc_distance = 50, tc_vrel = -15, tc_targetPresent = 1, tc_targetInLane = 1, tc_expectedSafe = 0, tc_expectedYellow = 1, tc_expectedRed = 0
    parameter set "PS_FCW_017" (off): tc_distance = 60, tc_vrel = -15, tc_targetPresent = 1, tc_targetInLane = 1, tc_expectedSafe = 0, tc_expectedYellow = 1, tc_expectedRed = 0
    parameter set "PS_FCW_018" (off): tc_distance = 60.1, tc_vrel = -15, tc_targetPresent = 1, tc_targetInLane = 1, tc_expectedSafe = 1, tc_expectedYellow = 0, tc_expectedRed = 0
    parameter set "PS_FCW_019" (off): tc_distance = 75.02, tc_vrel = -20, tc_targetPresent = 1, tc_targetInLane = 1, tc_expectedSafe = 0, tc_expectedYellow = 0, tc_expectedRed = 1
    parameter set "PS_FCW_020": tc_distance = 80, tc_vrel = -20, tc_targetPresent = 1, tc_targetInLane = 1, tc_expectedSafe = 0, tc_expectedYellow = 1, tc_expectedRed = 0
    iterations:
      FCW_001: ParameterSet "PS_FCW_001"
      FCW_002: ParameterSet "PS_FCW_002"
      FCW_003: ParameterSet "PS_FCW_003"
      FCW_004: ParameterSet "PS_FCW_004"
      FCW_005: ParameterSet "PS_FCW_005"
      FCW_006: ParameterSet "PS_FCW_006"
      FCW_007: ParameterSet "PS_FCW_007"
      FCW_008: ParameterSet "PS_FCW_008"
      FCW_009: ParameterSet "PS_FCW_009"
      FCW_010: ParameterSet "PS_FCW_010"
      FCW_011: ParameterSet "PS_FCW_011"
      FCW_012: ParameterSet "PS_FCW_012"
      FCW_013: ParameterSet "PS_FCW_013"
      FCW_014: ParameterSet "PS_FCW_014"
      FCW_015: ParameterSet "PS_FCW_015"
      FCW_016: ParameterSet "PS_FCW_016"
      FCW_017: ParameterSet "PS_FCW_017"
      FCW_018: ParameterSet "PS_FCW_018"
      FCW_019: ParameterSet "PS_FCW_019"
      FCW_020: ParameterSet "PS_FCW_020"